# Grasshopper definition CW section_3.2.gh (Grasshopper 1.0.7)
# plug-ins: Octopus, FalseStartToggle

honeybee = Honeybee_Honeybee()  # -> out; plug-in component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
ladybug = Ladybug_Ladybug()  # -> out; plug-in component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

# ----
# Variable panel count
# Shading Depth
# Window ratio x
# Center/Left/Right
# Window ratio y
i1_a = Slider(2.1, range=-5..5)
i1_b = Slider(10, range=1..15)
i3_a = Slider(0.19, range=0..0.25)
i3_b = Slider(0.8, range=0.1..1.1)
i2_a = Slider(0.19, range=-0.4..0.4)
i2_b = Slider(0.8, range=0.1..1.1)
i2_a_2 = Slider(-0.26, range=-0.4..0.4)
i2_b_2 = Slider(0.7, range=0.1..1.1)
clr_012 = Slider(0, range=0..2)

panel = Panel("""4
3
2
1
0""")
number = Number(panel)
number_2 = Number("14")
ghpython_script = GhPythonScript(a=i1_a, b=i1_b, max=number_2, x=number)  # -> out, y
# ---------- ghpython_script: Python ----------
__author__ = "BT"
__version__ = "2020.03.08"

import rhinoscriptsyntax as rs
c=abs(a*x+b)
if c>max:
    y=max
elif c<1:
    y=1
else:
    y=round(c,0)
# ---------- end ghpython_script ----------
ghpython_script_2 = GhPythonScript(a=i2_a, b=i2_b, x=number)  # -> out, y
# ---------- ghpython_script_2: Python ----------
__author__ = "BT"
__version__ = "2020.03.08"

import rhinoscriptsyntax as rs
y=abs(a*x+b)
if y>=1.0:
    y=0.99
elif y<=0.1:
    y=0.1
# ---------- end ghpython_script_2 ----------
ghpython_script_3 = GhPythonScript(a=i3_a, b=i3_b, x=number)  # -> out, y
# ---------- ghpython_script_3: Python ----------
__author__ = "BT"
__version__ = "2020.03.08"

import rhinoscriptsyntax as rs
y=a*x+b
if y>1.0:
    y=1
# ---------- end ghpython_script_3 ----------
ghpython_script_4 = GhPythonScript(a=i2_a_2, b=i2_b_2, x=number)  # -> out, y; same code as ghpython_script_2
panel_2 = Panel(ghpython_script.y)
# Inputs to grasshoppers geometry nodes
series = Series(Start=Slider(1, range=0..100), Step=Slider(0, range=0..1), Count=panel_2)

# ----
# Input 1
# Variable panel count
# Input 3
# Shading Depth
# Input 2
# Window ratio x
# Input 4
# Center/Left/Right
# Input 5
# Window ratio y
panel_3 = Panel(clr_012)
panel_4 = Panel(ghpython_script_2.y)
panel_5 = Panel(ghpython_script_4.y)
panel_6 = Panel(ghpython_script_3.y)
panel_7 = Panel(series)

# ----
# 100% Glazing to optimize
brep = Brep([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])

# ----
# Param 1 & 5 - Variable panel count on each floor with variable width for each panel
mass_addition = MassAddition(Input=panel_7)  # -> Result, PartialResults
deconstruct_domain² = DeconstructDomain²(Domain=brep)  # -> UComponent, graft(VComponent)
construct_domain = ConstructDomain(DomainStart=0, DomainEnd=mass_addition.Result)
remap_numbers = RemapNumbers(Value=mass_addition.PartialResults, Source=construct_domain, Target=deconstruct_domain².UComponent)  # -> Mapped, flatten(Clipped)
deconstruct_domain = DeconstructDomain(Domain=deconstruct_domain².UComponent)  # -> graft(Start), graft(End)
cull_index = CullIndex(List=remap_numbers.Mapped, Indices="-1", Wrap=True)
insert_items = InsertItems(List=cull_index, Item=deconstruct_domain.Start, Indices="0", Wrap=True)
construct_domain_2 = ConstructDomain(DomainStart=insert_items, DomainEnd=remap_numbers.Mapped)
construct_domain² = ConstructDomain²(DomainU=construct_domain_2, DomainV=deconstruct_domain².VComponent)
# Panels
isotrim = Isotrim(Surface=brep, Domain=graft(construct_domain²))  # -> simplify(Surface)

boolean_toggle = BooleanToggle(True)
clean_tree = CleanTree(RemoveNulls=boolean_toggle, RemoveInvalid=True, RemoveEmpty=boolean_toggle, Tree=isotrim)
trim_tree = TrimTree(Tree=clean_tree, Depth=1)

deconstruct_brep = DeconstructBrep(Brep=trim_tree)  # -> Faces, Edges, Vertices
trim_tree_2 = TrimTree(Tree=deconstruct_brep.Faces, Depth=1)
vector = Vector(trim_tree_2)
list_item = ListItem(List=vector, Index=0, Wrap=True)
# Param 3 - Variable overhang and fins depth on each floor
trim_tree_3 = TrimTree(Tree=deconstruct_brep.Edges, Depth=1)
multiplication = Multiplication(A=list_item, B=graft(panel_6))
vector_display = VectorDisplay(Anchor=deconstruct_brep.Vertices, Vector=multiplication)
line = Line(trim_tree_3)
deconstruct_vector = DeconstructVector(Vector=multiplication)  # -> XComponent, YComponent, ZComponent
vector_xyz = VectorXYZ(XComponent=deconstruct_vector.XComponent, YComponent=deconstruct_vector.YComponent, ZComponent=0)  # -> Vector, simplify(flatten(Length))
# Shading
extrude = Extrude(Base=line, Direction=vector_xyz.Vector)
panel_8 = Panel(vector_xyz.Length)

list_item_2 = ListItem(List=deconstruct_brep.Edges, Index=Slider(1, range=0..3), Wrap=True)
list_item_3 = ListItem(List=deconstruct_brep.Edges, Index=Slider(3, range=0..3), Wrap=True)
# Left
end_points = EndPoints(Curve=list_item_2)  # -> Start, End
# Right
end_points_2 = EndPoints(Curve=list_item_3)  # -> Start, End
trim_tree_4 = TrimTree(Tree=end_points.Start, Depth=1)
window_y_ratio = Number(graft(panel_4))
trim_tree_5 = TrimTree(Tree=end_points_2.End, Depth=1)
custom_preview = CustomPreview(Geometry=extrude, Material=ColourSwatch(SwatchColor=RGB(0, 0, 0)))
brep_2 = Brep([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])
# Adiabatic wall
brep_3 = Brep(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)
# Adiabatic floor
brep_4 = Brep(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)
# Roof
brep_5 = Brep(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)
# Wall with fixed glazing
brep_6 = Brep(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)
brep_7 = Brep([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])
brep_8 = Brep([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])
brep_9 = Brep([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])

# ----
# EP Simplified Context
# Surrounding buildings
# + ground plane
brep_10 = Brep([brep_8, extrude])

# ----
# Daylight Original Context
# Surrounding buildings
# + ground plane
brep_11 = Brep([brep_9, extrude])

face = HBFace(geo=brep_4, name="Floor", bc="Adiabatic")  # -> out, faces; plug-in component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
face_2 = HBFace(geo=brep_5, name="Roof", bc="Outdoors")  # -> out, faces; plug-in component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
face_3 = HBFace(geo=brep_7, name="Wall_FR", bc="Outdoors")  # -> out, faces; plug-in component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
face_4 = HBFace(geo=brep_6, name="Wall_L", bc="Outdoors")  # -> out, faces; plug-in component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
face_5 = HBFace(geo=brep_3, name="Adiabatic wall", bc="Adiabatic")  # -> out, faces; plug-in component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
# Fixed Glazing
move = Move(Geometry=brep_2, Motion="{0,0,0.01}")  # -> Geometry, Transform

panel_9 = Panel("""3.55
3.15
3.15
3.525""")
mass_addition_2 = MassAddition(Input=panel_9)  # -> Result, PartialResults
vector_2 = Vector("0,0,1")
multiplication_2 = Multiplication(A=vector_2, B=mass_addition_2.PartialResults)
move_2 = Move(Geometry=brep_4, Motion=multiplication_2)  # -> Geometry, Transform

brep_join = BrepJoin(Breps=[brep_7, brep_5, brep_6, brep_4, brep_3])  # -> Breps, Closed
split_brep_multiple = SplitBrepMultiple(Brep=brep_join.Breps, Cutters=move_2.Geometry)
relay = Relay([face.faces, face_5.faces, face_2.faces, face_4.faces, face_3.faces])
cap_holes = CapHoles(Brep=split_brep_multiple)
# E+ HB zone
room = HBRoom(faces=flatten(relay), conditioned=True)  # -> out, room; plug-in component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
panel_10 = Panel("""Room 1
Room 2
Room 3
Room 4
Room 5""")
roomsolid = HBRoomFromSolid(geo=flatten(cap_holes), name=panel_10, conditioned=True)  # -> out, rooms; plug-in component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
solveadj = HBSolveAdjacency(rooms=flatten(roomsolid.rooms), run=Toggle(True))  # -> out, adj_rooms; plug-in component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
hb_building_programs = HBBuildingPrograms({"LargeOffice", "MediumOffice", "SmallOffice", "MidriseApartment", "HighriseApartment", "Retail", "StripMall", "PrimarySchool", "SecondarySchool", "SmallHotel", "LargeHotel", "Hospital", "Outpatient", "Laboratory", "Warehouse", "SuperMarket", "FullServiceRestaurant", "QuickServiceRestaurant", "Courthouse", "LargeDataCenterHighITE", "LargeDataCenterLowITE", "SmallDataCenterHighITE", "SmallDataCenterLowITE"}, selected="MediumOffice")

number_slider = Slider(0.8, range=0..1)
number_slider_2 = Slider(0.6, range=0..1)
opaquemod = HBOpaqueModifier(name="Carpet", reflect=number_slider, spec=number_slider)  # -> modifier; plug-in component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
# RAD MATERIALS
opaquemod_2 = HBOpaqueModifier(name="Interior", reflect=number_slider_2, spec=number_slider_2)  # -> modifier; plug-in component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
interiorsubset = HBInteriorModifierSubset(interior_wall=opaquemod_2, ceiling=opaquemod_2, interior_floor=opaquemod)  # -> interior_set; plug-in component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

glassmod = HBGlassModifier(name="Window", trans="0.8", refract="1.52")  # -> modifier; plug-in component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
subfacesubset = HBSubfaceModifierSubset(window=glassmod)  # -> subface_set; plug-in component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

shade = HBShade(geo=brep_10)  # -> out, flatten(shades); plug-in component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

number_slider_3 = Slider(0.3, range=0..1)
opaquemod_3 = HBOpaqueModifier(name="Shade", reflect=number_slider_3, spec=number_slider_3)  # -> modifier; plug-in component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

epw = FilePath("C:\Users\amd\Documents\GitHub\UCL-SBDE-CW\BENV0042 - Multi Objective Design Optimisation\GBR_London.epw")
epwtoddy = LBEPWToDDY(epw_file=epw, write=Toggle(True))  # -> ddy_file; plug-in component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
simcontrol = HBSimulationControl()  # -> sim_control; plug-in component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
sizingpar = HBSizingParameter(ddy_file=epwtoddy)  # -> sizing; plug-in component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
analysisperiod = LBAnalysisPeriod(start_month="1", start_day="1", start_hour=0, end_month="6", end_day="30")  # -> period, hoys, dates; plug-in component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
modifierset = HBModifierSet(interior_subset=interiorsubset, subface_subset=subfacesubset)  # -> mod_set; plug-in component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
shade_2 = HBShade(geo=brep_11, rad_mod=opaquemod_3)  # -> out, flatten(shades); plug-in component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
simpar = HBSimulationParameter(run_period=analysisperiod.period, timestep="2", sim_control=simcontrol, sizing=sizingpar)  # -> sim_par; plug-in component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
false_start_toggle = FalseStartToggle(True)
false_start_toggle_2 = FalseStartToggle(True)
legendpar = LBLegendParameters(min=Slider(0, range=0..100), max=Slider(5, range=0..10))  # -> leg_par; plug-in component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
min_df = Panel("""5
5
5
5
5""")
octopus = Octopus(
    OctopusData_gene=[i2_b_2, clr_012, i2_a_2, i3_b, i3_a, i1_b, i1_a, i2_a, i2_b],
    OctopusData_obj=[energy_objective, daylighitng_objective])

# ----
# Param 2 - Variable window ratio on each floor
# Windows
surface = Surface(trim_tree)
panel_11 = Panel(panel_5)
# Center
area = Area(Geometry=surface)  # -> Area, Centroid
construct_domain_3 = ConstructDomain(DomainStart=0, DomainEnd=area.Area)
remap_numbers_2 = RemapNumbers(Value=graft(panel_11), Source=construct_domain_3, Target=construct_domain_3)  # -> Mapped, Clipped

stream_filter = StreamFilter(Gate=panel_3, Stream0=area.Centroid, Stream1=trim_tree_4, Stream2=trim_tree_5)

plane_normal = PlaneNormal(Origin=stream_filter, ZAxis=vector)
scale_nu = ScaleNU(Geometry=surface, Plane=plane_normal, ScaleX=remap_numbers_2.Mapped, ScaleY=window_y_ratio, ScaleZ=1)  # -> Geometry, Transform

# ----
# Parametric glazing
brep_12 = Brep(scale_nu.Geometry)

deconstruct_brep_2 = DeconstructBrep(Brep=brep_12)  # -> Faces, Edges, Vertices
is_planar = IsPlanar(Surface=deconstruct_brep_2.Faces, Interior=True)  # -> Planar, Plane
# Front and right wall
scale_nu_2 = ScaleNU(Geometry=deconstruct_brep_2.Faces, Plane=is_planar.Plane, ScaleX=1, ScaleY=Slider(1, range=0.1..1), ScaleZ=1)  # -> Geometry, Transform
# Parametric glazing
move_3 = Move(Geometry=flatten(scale_nu_2.Geometry), Motion="{0,0,0.01}")  # -> Geometry, Transform
relay_2 = Relay([move.Geometry, move_3.Geometry])
aperture = HBAperture(geo=relay_2)  # -> out, apertures; plug-in component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
# add glazing to HB zone
addsubface = HBAddSubface(hb_obj=flatten(room.room), sub_faces=flatten(aperture.apertures))  # -> hb_obj; plug-in component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
# Add both fixed and variable glazing
aperture_2 = HBAperture(geo=relay_2)  # -> out, apertures; plug-in component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
# HB zones for Daylighting
addsubface_2 = HBAddSubface(hb_obj=flatten(solveadj.adj_rooms), sub_faces=flatten(aperture_2.apertures))  # -> hb_obj; plug-in component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
applyprogram = HBApplyProgramType(rooms=flatten(addsubface), program=hb_building_programs)  # -> out, rooms; plug-in component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
model = HBModel(rooms=flatten(applyprogram.rooms), shades=flatten(shade.shades))  # -> out, model; plug-in component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
applymodset = HBApplyModifierSet(rooms=addsubface_2, mod_set=modifierset)  # -> rooms; plug-in component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
gridrooms = HBSensorGridFromRooms(rooms=applymodset, grid_size=Slider(1, range=0..1), dist_floor="0.8")  # -> grid, points, graft(mesh); plug-in component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
model_2 = HBModel(rooms=flatten(applymodset), shades=flatten(shade_2.shades))  # -> out, model; plug-in component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
modeltoosm = HBModelToOSM(model=model.model, epw_file=epw, sim_par=simpar, write=false_start_toggle, run="3")  # -> out, jsons, osw, osm, idf, sql, zsz, rdd, html; plug-in component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
vizbytype = HBVisualizeByType(hb_objs=model_2.model)  # -> walls, interior_walls, roofs, ceilings, exterior_floors, interior_floors, air_walls, apertures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; plug-in component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
eui = HBEndUseIntensity(sql=modeltoosm.sql)  # -> eui, eui_end_use, end_uses, gross_floor; plug-in component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
assigngridsviews = HBAssignGridsAndViews(model=model_2.model, grids=flatten(gridrooms.grid))  # -> model; plug-in component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
vizwiref = HBVizualizeWireframe(hb_objs=flatten(assigngridsviews))  # -> geo; disabled; plug-in component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
multiplication_3 = Multiplication(A="-2", B=eui.eui)
daylightfactor = HBDaylightFactor(model=assigngridsviews, run=false_start_toggle_2)  # -> out, results; plug-in component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
custom_preview_2 = CustomPreview(
    Geometry=vizbytype.apertures,
    Material={diffuse=RGB(221, 160, 221), emission=RGB(66, 48, 66), shine=0.5, specular=RGB(255, 255, 255), transparency=0})
heatmap = LBSpatialHeatmap(values=daylightfactor.results, mesh=gridrooms.mesh, legend_par=legendpar)  # -> mesh, legend, title, colors, legend_par; plug-in component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
number_3 = Number(daylightfactor.results)
larger_than = LargerThan(FirstNumber=daylightfactor.results, SecondNumber=graft(min_df))  # -> LargerThan, OrEqualTo
average = Average(Input=number_3)  # -> reverse(flatten(ArithmeticMean))
mass_addition_3 = MassAddition(Input=larger_than.LargerThan)  # -> Result, PartialResults
average_2 = Average(Input=average)  # -> reverse(flatten(ArithmeticMean))
number_of_cells_above_min_df = Panel(mass_addition_3.Result)
list_length = ListLength(List=mass_addition_3.PartialResults)
division = Division(A=mass_addition_3.Result, B=list_length)
multiplication_4 = Multiplication(A=Slider(100, range=0..100), B=division)  # -> flatten(Result)
mass_addition_4 = MassAddition(Input=multiplication_4)  # -> Result, PartialResults
negative = Negative(Value=mass_addition_4.Result)
panel_12 = Panel(multiplication_4)
daylighitng_objective = Number(negative)
energy_objective = Number(multiplication_3)
merge = Merge(Data1=energy_objective, Data2=daylighitng_objective)
panel_13 = Panel(merge)
